# Dynamo graph Geodesic Dome.dyn "1925_Geodesic Dom Script" (Dynamo 2.12.1.8246)

diameter_dome = DoubleSlider(9500, range=-1000..24400 step 1)
code_block = CodeBlock()
# ---------- code_block.designscript (34 lines) ----------
//create isohedron

p = (1+DSCore.Math.Sqrt(5))/2;

a = Autodesk.Point.ByCoordinates(
[0,0,0,0,p,-p,-p,p,1,-1,-1,1],
[1,-1,-1,1,0,0,0,0,p,p,-p,-p],
[p,p,-p,-p,1,1,-1,-1,0,0,0,0]
);

b=[
[a[0],a[8],a[9]],
[a[0],a[9],a[5]],
[a[0],a[5],a[1]],
[a[0],a[1],a[4]],
[a[0],a[4],a[8]],
[a[1],a[5],a[10]],
[a[1],a[10],a[11]],
[a[1],a[11],a[4]],
[a[2],a[3],a[7]],
[a[2],a[7],a[11]],
[a[2],a[11],a[10]],
[a[2],a[10],a[6]],
[a[2],a[6],a[3]],
[a[3],a[6],a[9]],
[a[3],a[9],a[8]],
[a[3],a[8],a[7]],
[a[4],a[11],a[7]],
[a[4],a[7],a[8]],
[a[5],a[9],a[6]],
[a[5],a[6],a[10]]
];

tri = Autodesk.Surface.ByPerimeterPoints(b);
# ----------------------------------------
code_block_2 = CodeBlock(list=code_block.tri)
# ---------- code_block_2.designscript (12 lines) ----------
ax1 = Surface.PerimeterCurves(List.GetItemAtIndex(list,2));
ax2 = Surface.PerimeterCurves(List.GetItemAtIndex(list,14));

ax3 = ax1[1].PointAtParameter(1);
ax4 = ax2[0].PointAtParameter(0);

ax5 = Line.ByStartPointEndPoint(ax3,ax4);

ax5.CoordinateSystemAtParameter(0);

//YZ Plane Element
CoordinateSystem.ByPlane(Plane.YZ());
# ----------------------------------------
transform = Geometry.Transform(geometry=code_block.tri, fromCoordinateSystem=code_block_2.out5, contextCoordinateSystem=code_block_2.out6)
code_block_3 = CodeBlock(p=code_block_2.ax5) { r = p.Length; -r/2; }
translate = Geometry.Translate(geometry=transform, zTranslation=code_block_3.out1)
tessellation_iriterations = IntegerSlider(3, range=1..6 step 1)
code_block_4 = CodeBlock(surf=translate, d=tessellation_iriterations)
# ---------- code_block_4.designscript (39 lines) ----------
//Surface si from Geo Transform
//D is primary Divisions

//Edges of Equilateral Surface
crv1 = Surface.PerimeterCurves(surf);
len1 = List.GetItemAtIndex(crv1<1>,0).Length;
n = d<1?1:d;
len2 = len1/n;

//Vertices of Equalateral Surface
pnt1 = List.GetItemAtIndex(crv1<1>,0).StartPoint;
pnt2 = List.GetItemAtIndex(crv1<1>,1).StartPoint;
pnt3 = List.GetItemAtIndex(crv1<1>,2).StartPoint;

dir1 = Vector.ByTwoPoints(pnt1, pnt2);
dir2 = Vector.ByTwoPoints(pnt1, pnt3);
dir3 = Vector.ByTwoPoints(pnt2, pnt3);

//Subtraingles 1
pnt4 = pnt1.Translate(dir1,len2);
pnt5 = pnt1.Translate(dir2,len2);
sub1 = Polygon.ByPoints(Transpose([pnt1,pnt4,pnt5]));

//Repeating Subtraingles
n2 = (0..(n-1)) * len2<1>;
sub2 = sub1.Translate(dir1,n2);
n3 = List.TakeItems(n2<1>,1..n);
sub3 = sub2.Translate(dir3,n3);

//Subtraingle 2
pnt6 = n<2?pnt1:pnt4.Translate(dir2,len2);
sub4 = Polygon.ByPoints(Transpose([pnt4,pnt5,pnt6]));
n4 = (0..(n-2)) * len2<1>;
sub5 = sub4.Translate(dir1,n4);
n5 = List.TakeItems(n4<1>,1..n);
sub6 = sub5.Translate(dir3,n5);

//OUTPUT
srf21 = DSCore.List.Flatten(List.TakeItems([sub3,sub6],n));
# ----------------------------------------
z_offset = DoubleSlider(-250, range=-1000..1000 step 1)
code_block_5 = CodeBlock(dai=diameter_dome, surf1=code_block_4.srf21, ztotals=z_offset)
# ---------- code_block_5.designscript (19 lines) ----------
//Create sphere
r = dai/2;
ra = r-(r*0.001);
sph = Sphere.ByCenterPointRadius(Autodesk.Point.Origin(),ra);
Circle.ByCenterPointRadius(Autodesk.Point.Origin(),r);
curv1 = Surface.PerimeterCurves(Surface.ByPatch(surf1));
curv2 = curv1.PointAtParameter(0);
vec1 = Vector.ByTwoPoints(Autodesk.Point.Origin(),curv2);

//Project points onto sphere
pt2 = DSCore.List.Flatten(sph.ProjectInputOnto(curv2,vec1));

//ReCreate Surfaces on Sphere
surf2 = Surface.ByPerimeterPoints(List.Chop(pt2,3));
PolySurface.ByJoinedSurfaces(surf2);

bools = surf2.PointAtParameter(0.5,0.5).Z > ztotals;
surf3 = DSCore.List.Flatten(List.GetItemAtIndex(List.FilterByBoolMask(surf2,bools),0));
PolySurface.ByJoinedSurfaces(surf3);
# ----------------------------------------
filterByBoolMask = List.FilterByBoolMask(list=code_block_5.surf2, mask=code_block_5.bools)
byJoinedSurfaces = PolySurface.ByJoinedSurfaces(surfaces=filterByBoolMask.in)
edges = Topology.Edges(topology=byJoinedSurfaces)
curveGeometry = Edge.CurveGeometry(edge=edges)
levels = Levels("01_eerste verdieping")
structural_framing_types = StructuralFramingTypes("HB 71x196")
beamByCurve = StructuralFraming.BeamByCurve(curve=curveGeometry, level=levels, structuralFramingType=structural_framing_types)  # frozen
